# Grasshopper definition Minimum bounding rectangle.gh (Grasshopper 1.0.7)

# ---- group: Grasshopper component: points
xy_plane = XYPlane(Origin=Point(0, 0, 0))
point = Point([Point(-0.6076890244, 13.55613978, 0), Point(2.19702955, 16.82831145, 0), Point(6.965051126, 13.83661163, 0), Point(3.599388837, 8.133683865, 0), Point(12.57448827, 8.975099438, 0), Point(12.85496013, 14.30406473, 0), Point(16.50109428, 15.33246154, 0), Point(17.24901923, 9.629533772, 0)])
bounding_box = BoundingBox(Content=point, Plane=xy_plane, UnionBox=True)  # -> Box, Box_2

# ---- group: Python: points
xy_plane_2 = XYPlane(Origin=Point(0, 0, 0))
point_2 = Point([Point(-0.6076890244, 13.55613978, 0), Point(2.19702955, 16.82831145, 0), Point(6.965051126, 13.83661163, 0), Point(3.599388837, 8.133683865, 0), Point(12.57448827, 8.975099438, 0), Point(12.85496013, 14.30406473, 0), Point(16.50109428, 15.33246154, 0), Point(17.24901923, 9.629533772, 0)])
ghpython_script = GhPythonScript(x=point_2, y=xy_plane_2)  # -> out, a; inputs x: list of Point3d
# ---------- ghpython_script: Python ----------
import rhinoscriptsyntax as rs
import Rhino.Geometry as rg
a = rg.Box(y, x)
# ---------- end ghpython_script ----------

# ---- group: Python points 2D only
point_3 = Point([Point(150.7923354, -100.2694136, 0), Point(115.6467035, -80.24457688, 0), Point(76.00570022, -83.10526785, 0), Point(76.00570022, -56.54170892, 0), Point(85.81378352, -27.11745903, 0), Point(117.6900542, -59.40239988, 0), Point(149.9749951, -41.0122437, 0), Point(152.835686, -70.02782345, 0)])
ghpython_script_2 = GhPythonScript(point=point_3)  # -> out, a; inputs point: list of Point3d
# ---------- ghpython_script_2: Python ----------
import rhinoscriptsyntax as rs
import Rhino.Geometry as rg
import math
#Empty lists for coordinates of points
listx = []
listy = []

#Finding max and min coordinates
for i in point:
    listx.append(i.X)
    listy.append(i.Y)
maxx = max(listx)
minx = min(listx)
maxy = max(listy)
miny = min(listy)

#Vertical Bounding box 
point1 = rg.Point3d(maxx,maxy,0)
point2 = rg.Point3d(minx,miny,0)
a = rg.BoundingBox(point2, point1)
# ---------- end ghpython_script_2 ----------
geometry = Geometry(ghpython_script_2.a)

# ---- group: Python Points 3D also
# XY Minimum Bounding Rectangle for 3D points
point_4 = Point([Point(149.9749951, -41.0122437, 21.10218367), Point(152.835686, -70.02782345, 21.10218367), Point(150.7923354, -100.2694136, -19.96839277), Point(115.6467035, -80.24457688, 23.02552102), Point(76.00570022, -56.54170892, 12.81259534), Point(76.00570022, -83.10526785, -20.57123318), Point(85.81378352, -27.11745903, 0), Point(117.6900542, -59.40239988, -14.17095194)])
ghpython_script_3 = GhPythonScript(point=point_4)  # -> out, a; inputs point: list of Point3d
# ---------- ghpython_script_3: Python ----------
import rhinoscriptsyntax as rs
import Rhino.Geometry as rg
import math
#Empty lists for coordinates of points
listx = []
listy = []
listz = []

#Finding max and min coordinates
for i in point:
    listx.append(i.X)
    listy.append(i.Y)
    listz.append(i.Z)
maxx = max(listx)
minx = min(listx)
maxy = max(listy)
miny = min(listy)
maxz = max(listz)
minz = min(listz)

#Vertical 3D Bounding box 
point1 = rg.Point3d(maxx,maxy,maxz)
point2 = rg.Point3d(minx,miny,minz)
a = rg.Box(rs.WorldXYPlane(), rg.Interval(maxx,minx), rg.Interval(maxy,miny), rg.Interval(maxz,minz))
# ---------- end ghpython_script_3 ----------
geometry_2 = Geometry(ghpython_script_3.a)

# ---- group: Grasshopper component: geometry
xy_plane_3 = XYPlane(Origin=Point(0, 0, 0))
geometry_3 = Geometry([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])
bounding_box_2 = BoundingBox(Content=geometry_3, Plane=xy_plane_3, UnionBox=True)  # -> Box, Box_2

# ---- group: Python 1 curve
geometry_4 = Geometry(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)
ghpython_script_4 = GhPythonScript(x=geometry_4)  # -> out, a; inputs x: GeometryBase
# ---------- ghpython_script_4: Python ----------
import rhinoscriptsyntax as rs
import Rhino.Geometry as rg
a = rg.Box(rs.WorldXYPlane(),x)
# ---------- end ghpython_script_4 ----------
